test file "testerdvig"

suite "New Test Suite 1"

  case "constant test" [baseline]
    model dvig_harness
    signal scenario: testerconstant (dvig_harness/Harness Inputs)
    assessment "Assessment1": At any point of time, ygol must be greater than 30
      ygol: signal dvig_harness/Output Conversion Subsystem, port 1

  case "sinetest" [baseline]
    model dvig_harness
    signal scenario: testersine (dvig_harness/Harness Inputs)
    assessment "Assessment1": At any point of time, ygol must be greater than 30
      ygol: signal dvig_harness/Output Conversion Subsystem, port 1

  case "pulsetest" [baseline]
    model dvig_harness
    signal scenario: testerpulse (dvig_harness/Harness Inputs)
    assessment "Assessment1": At any point of time, ygol must be greater than 30
      ygol: signal dvig_harness/Output Conversion Subsystem, port 1